vi "Index.gviweb"   [LabVIEW NXG 3.1.0]
panel controls:
  "C++ Source": string
  "Compile": bool
  "Run": bool
  "Result name": string = "B"
  "plot result": bool
  "Examples": T1 = "Hello World"
  "Input name": string = "X"
  "Num rand pts": f64 = 100
  "Set input": bool
panel indicators:
  "Result": f64[]
  "Output": error
types:
  T1 = enum{"Hello World", "Timer", "Indexed DB", "Virtual File System Write", "Run JavaScript", "Armadillo", "Armadillo_in_out", "Sigpack"}
uses:
  CIB::CIB.jsli::CreateCompiler
  CIB::CIB.jsli::CreateRuntime
  CIB::CIB.jsli::ExecuteCompiler
  CIB::CIB.jsli::ExecuteRuntime
  WebApp::Examples.gviweb
  CIB::CIB.jsli::GetSavedResult
  CIB::CIB.jsli::SetInputValue
diagram:
  call "PanelController.gviweb"(panel action="Initialize", run=reference to "Run", compile=reference to "Compile") -> (error out=w1)
  call "PanelController.gviweb"(panel action="Disable Buttons", error in=w1) -> (error out=w2)
  call "CreateCompiler"(error in=w2) -> (compiler refnum=w3, error out=w4)
  call "CreateRuntime"(error in=w2) -> (runtime refnum=w5, error out=w6)
  Merge Errors(w4, w6) -> (error out=w7)
  call "PanelController.gviweb"(panel action="Enable Buttons", error in=w7) -> (error out=w8)
  s1 = u8[] []  # shift register
  while {
    event {
      on "Compile" Value changed {
        call "PanelController.gviweb"(panel action="Disable Buttons", error in=w8) -> (error out=w11)
        call "ExecuteCompiler"(compiler refnum=w3, source=$"C++ Source", error in=w11) -> (wasm=w9, error out=w12)
        call "PanelController.gviweb"(panel action="Enable Buttons", error in=w12) -> (error out=w10)
      }
      on "Run" Value changed {
        Array Size(array=s1) -> (size(s)=w13)
        Is Greater Than 0(x=w13) -> w14
        case (w14) {
          frame False, Default {
            One Button Dialog(message="Compilation not available")
            w10 = w8
          }
          frame True {
            call "PanelController.gviweb"(panel action="Disable Buttons", error in=w8) -> (error out=w15)
            call "ExecuteRuntime"(runtime refnum=w5, wasm=s1, error in=w15) -> (error out=w16)
            call "PanelController.gviweb"(panel action="Enable Buttons", error in=w16) -> (error out=w10)
          }
        }
        w9 = s1
      }
      on "Examples" Value changed {
        call "Examples.gviweb"(example=$Examples) -> (source=w17)
        $"C++ Source" <- w17
        w9 = u8[] []
        w10 = w8
      }
      on "plot result" Value changed {
        call "PanelController.gviweb"(panel action="Disable Buttons", error in=w8) -> (error out=w18)
        call "GetSavedResult"(runtime refnum=w5, name=$"Result name", error in=w18) -> (return=w19, error out=w20)
        call "PanelController.gviweb"(panel action="Enable Buttons", error in=w20) -> (error out=w10)
        $Result <- w19
        w9 = s1
      }
      on "Set input" Value changed {
        w21 = $"Num rand pts"
        for (N = w21) {
          Random Number() -> (number (0 to 1)=w23)
          append w23 to w22
        }
        call "PanelController.gviweb"(panel action="Disable Buttons", error in=w8) -> (error out=w24)
        call "SetInputValue"(runtime refnum=w5, name=$"Input name", value=w22, error in=w24) -> (error out=w25)
        call "PanelController.gviweb"(panel action="Enable Buttons", error in=w25) -> (error out=w10)
        w9 = s1
      }
    }
    $Output <- w10
    next s1 = w9
    stop if w10
  }
